# Dynamo graph EC2_01_Muros.dyn (Dynamo 3.6.0.9395)

file_path = Filename(".\EC2_01_Muros.xlsx")
string = StringInput("Hoja1")
categories = Categories("OST_Walls")
all_elements_of_category = ElementsOfCategory(Category=categories)
python_script = Python(IN[0]=all_elements_of_category)  # CPython3
# ---------- python_script.python (50 lines) ----------
import clr
clr.AddReference('RevitServices')
import RevitServices
from RevitServices.Persistence import DocumentManager
 
clr.AddReference('RevitAPI')
from Autodesk.Revit.DB import *
 
doc = DocumentManager.Instance.CurrentDBDocument
 
# Desenvolver los elementos de Dynamo a elementos nativos de Revit
entrada = IN[0]
if not isinstance(entrada, list):
    entrada = [entrada]
elementos = [UnwrapElement(e) for e in entrada]
 
registros = []
 
for el in elementos:
    # Tipo de muro y su nombre
    tipo = doc.GetElement(el.GetTypeId())
    nombre_tipo = tipo.get_Parameter(BuiltInParameter.SYMBOL_NAME_PARAM).AsString()
 
    # Nivel base del muro
    nivel_el = doc.GetElement(el.LevelId)
    nivel = nivel_el.Name if nivel_el else None
 
    registros.append({
        "Id": el.Id.Value,
        "Nombre": nombre_tipo,
        "Nivel": nivel
    })
 
# Comillas simples por fuera porque el nombre incluye el símbolo " (pulgadas)
valores_validos = ['Exterior - B', 'Exterior - M', 'Interior - C']
 
for r in registros:
    nombre = r["Nombre"].strip() if r["Nombre"] else ""
    if nombre == "":
        r["Estado"] = "Falta parámetro"
    elif nombre not in valores_validos:
        r["Estado"] = "Fuera de estándar"
    else:
        r["Estado"] = "OK"
 
encabezados = ["Id", "Nombre", "Nivel", "Estado"]
filas = [[r["Id"], r["Nombre"], r["Nivel"], r["Estado"]]
         for r in registros]
 
OUT = [encabezados] + filas
# ----------------------------------------
watch = Watch(python_script)
openXMLExportExcel = Data.OpenXMLExportExcel(filePath=file_path, sheetName=string, data=watch)
